% Simulink data dictionary data.sldd

actuatorCentres = struct(
  aileron=struct(left=0, right=0),
  elevator=struct(left=0, right=0),
  rudder=0,
  flap=struct(left=0, right=0))

deflectionLimits = struct(
  aileron=struct(min=-10, max=10),
  elevator=struct(min=-10, max=10),
  rudder=struct(min=-5, max=5),
  flap=struct(min=0, max=15))

initCond = struct(x0=[0 0 0], v0=[0 0 0], euler0=[0 0 0], w0=[0 0 0])

servoPins = struct(
  aileron=struct(left=9, right=10),
  elevator=struct(left=7, right=8),
  rudder=11,
  flap=struct(left=5, right=6))

States = Simulink.Bus()
  X_e: double[3], Unit="m"
  euler_angles: double[3], Unit="rad"
  V_b: double[3], Unit="m/s"
  omega: double[3], Unit="rad/s"
  omega_dot: double[3], Unit="rad/s^2"
  A_be: double[3], Unit="m/s^2"

initConditions = struct(x0=[0 0 0], v0=[0 0 0], euler0=[0 0 0], w0=[0 0 0])
envConsts = struct(magVar=-1.3, refHeight=0)

Errors = Simulink.Bus()
  PRESS_OOB_ERROR: boolean
  TEMP_OOB_ERROR: boolean
  AIRFRAME_G_LIMIT_EXCEEDED: boolean
  GPS_FIX_BAD: boolean

Sensors = Simulink.Bus()
  Pressure: double, Unit="Pa"
  Temperature: double, Unit="°C"
  omega_dot: double[3], Unit="rad/s^2"
  omega: double[3], Unit="rad/s"
  euler_angles: double[3], Unit="rad"
  A_be: double[3], Unit="m/s^2"
  V_b: double[3], Unit="m/s"
  X_e: double[3], Unit="m"
  Heading: double, Unit="deg"
  GPS_LLA: double[3]
  GPS_GS: double, Unit="kn"
  Altitude: double, Unit="m"

ActuatorStates = Simulink.Bus()
  Aileron: double, Unit="deg"
  Elevator: double, Unit="deg"
  Rudder: double, Unit="deg"
  Flap: double, Unit="deg"

AutoflightDemandedValues = Simulink.Bus()
  FlightMode: Enum: FlightMode
  HoldAltitude: double, Unit="m"
  HoldSpeed: double, Unit="kn"
  HoldHeading: double, Unit="deg"
  LLATarget: double

Uplink = Simulink.Bus()
  AutoflightRefValues: Bus: AutoflightDemandedValues
  ControlOverride: Bus: ControlOverrides

Downlink = Simulink.Bus()
SimType = 0

Sim_Mode = Simulink.VariantConfigurationData(
  VariantConfigurations=[struct(
    Name="Prelim",
    Description="",
    ControlVariables=struct(Name="SimType", Value="0", Source="data.sldd"),
    SubModelConfigurations=[]), struct(
    Name="MIL",
    Description="",
    ControlVariables=struct(Name="SimType", Value="1", Source="data.sldd"),
    SubModelConfigurations=[]), struct(
    Name="SIL",
    Description="",
    ControlVariables=struct(Name="SimType", Value="2", Source="data.sldd"),
    SubModelConfigurations=[])],
  DefaultConfigurationName="Prelim")

Commands = Simulink.Bus()
  Aileron: double, Unit="deg"
  Elevator: double, Unit="deg"
  Rudder: double, Unit="deg"
  Flap: double, Unit="deg"
  Throttle: double

ControlOverrides = Simulink.Bus()
  Aileron: double
  Elevator: double
  Rudder: double
  Flap: double
  Throttle: double

FlightMode = enum(DefaultValue="manOverride")
  manOverride = 0
  autoclimb = 0
  speedHold = 0
  altHold = 0
  hdgHold = 0

Demands = Simulink.Bus()
  FlightMode: double
  Altitude: double, Unit="m"
  Heading: double, Unit="deg"
  GroundSpeed: double, Unit="m/s"
  PositionTarget: double[2]
  ControlOverrides: Bus: ControlOverrides

vehicle = struct(
  mass=5,
  inertia=[1 0 0; 0 1 0; 0 0 1],
  wingspan=3,
  wingarea=0.2,
  aclength=0.8,
  CG=[0 0 0],
  CP=[0.01 0 -0.001],
  stallSpeed=30)